vi "Main.gviweb"   [LabVIEW NXG 1.0.0]
panel controls:
  "Slider": f64
  "Slider_2": f64
panel indicators:
  "Tank": f64
  "Graph": f64[]
diagram:
  while {
    Add($Slider, $Slider_2) -> w1
    $Tank <- w1
    Wait(time to wait=150)
    stop if FALSE
  }
  while {
    for (N = 100) {
      Random Number() -> (number (0 to 1)=w3)
      Multiply(w3, 100) -> w4
      append w4 to w2
    }
    $Graph <- w2
    Wait(time to wait=16)
    stop if FALSE
  }
